# Grasshopper definition UDP C4D TO GH.gh (Grasshopper 0.9.76)
# plug-ins: gHowl

ip_to_receive_on_this_computer = Panel("192.168.1.15")
port_to_receive_on = Panel("7654")
udp = UDPReceiver(Address=ip_to_receive_on_this_computer, Port=port_to_receive_on, Pattern=0)  # -> Info, Data
panel = Panel(udp.Info)
panel_2 = Panel(udp.Data)
split = TextSplit(Text=panel_2, Separators=",")
panel_3 = Panel(split)
rep = ReplaceText(Text=panel_3, Find="(", RecursiveReplace=False)
rep_2 = ReplaceText(Text=rep, Find=")", RecursiveReplace=False)
partition = PartitionList(List=rep_2, Size="3")  # -> simplify(Chunks)
cir = Circle(Plane=PlaneXY(0, 0, 0), Radius=Slider(10, range=0..10))
panel_4 = Panel(partition)
boundary = BoundarySurfaces(Edges=cir)
round = Round(Number=panel_4)  # -> Nearest, Floor, Ceiling
branch = TreeBranch(Tree=round.Nearest, Path="{0}", MaintainPaths=True)
branch_2 = TreeBranch(Tree=round.Nearest, Path="{0} ;", MaintainPaths=True)
panel_5 = Panel(branch)
panel_6 = Panel(branch_2)
item = ListItem(List=panel_5, Index=0, Wrap=True)
item_2 = ListItem(List=panel_5, Index=1, Wrap=True)
item_3 = ListItem(List=panel_5, Index=2, Wrap=True)
rgb = ColourRGB(Alpha=255, Red=item, Green=item_2, Blue=item_3)
panel_7 = Panel(rgb)
preview = CustomPreview(Geometry=boundary, Shader=rgb)
